# Grasshopper definition tests.gh (Grasshopper 1.0.8)
# Copyright: GNU Lesser General Public License Version 3
# plug-ins: RhinoCodePluginGH, semio

dir = Directory()  # -> D
# ---------- dir: C# ----------
#region Usings
using System;
using System.Linq;
using System.Collections;
using System.Collections.Generic;
using System.Drawing;
using System.IO;

using Rhino;
using Rhino.Geometry;

using Grasshopper;
using Grasshopper.Kernel;
using Grasshopper.Kernel.Data;
using Grasshopper.Kernel.Types;
#endregion

public class Script_Instance : GH_ScriptInstance
{
    private void RunScript(ref object D)
    {
        D = Path.GetDirectoryName(this.GrasshopperDocument.FilePath);
    }
}
# ---------- end dir ----------
sep = Separator()  # -> S
# ---------- sep: C# ----------
#region Usings
using System;
using System.Linq;
using System.Collections;
using System.Collections.Generic;
using System.Drawing;
using System.IO;

using Rhino;
using Rhino.Geometry;

using Grasshopper;
using Grasshopper.Kernel;
using Grasshopper.Kernel.Data;
using Grasshopper.Kernel.Types;
#endregion

public class Script_Instance : GH_ScriptInstance
{
    private void RunScript(ref object S)
    {
        S = Path.DirectorySeparatorChar;
    }
}
# ---------- end sep ----------
panel = Panel(".gh")
par = ParentDirectory(D=dir)  # -> P; inputs D: String
# ---------- par: C# ----------
#region Usings
using System;
using System.Linq;
using System.Collections;
using System.Collections.Generic;
using System.Drawing;
using System.IO;

using Rhino;
using Rhino.Geometry;

using Grasshopper;
using Grasshopper.Kernel;
using Grasshopper.Kernel.Data;
using Grasshopper.Kernel.Types;
#endregion

public class Script_Instance : GH_ScriptInstance
{
    private void RunScript(string D, ref object P)
    {
        P = new DirectoryInfo(D).Parent;
    }
}
# ---------- end par ----------
concat = Concatenate(FragmentA=dir, FragmentD=sep, FragmentB="local")
par_2 = ParentDirectory(D=par)  # -> P; inputs D: String; same code as par
concat_2 = Concatenate(FragmentA=concat, FragmentC=sep, FragmentE="kit")
concat_3 = Concatenate(FragmentA=concat, FragmentD=sep, FragmentC="ai")
concat_4 = Concatenate(FragmentA=par_2, FragmentB=sep, FragmentC="examples")
concat_5 = Concatenate(FragmentA=concat_4, FragmentB=sep, FragmentC="metabolism")

load_kit = BooleanToggle(False)
kit = LoadKit(Uri=concat_5, Run=load_kit)  # -> Success, Kit, LocalDirectory
kit_2 = CreateKit(Kit=kit.Kit, Uri=concat_2, Run=load_kit)
kt = Kit("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")
kit_3 = ModelKit(Kit=kt)  # -> Kit, Valid, Name, Description, Icon, Image, Preview, Version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
trim = TrimTree(Tree=kit_3.Types, Depth=1)
trim_2 = TrimTree(Tree=kit_3.Designs, Depth=1)
kt_2 = Kit(kit_3.Kit)
ty = Type(trim)
dn = Design(trim_2)

typ = ModelType(Type=ty)  # -> Type, Valid, Name, Description, Icon, Image, Variant, Unit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
qal = ModelQuality(Quality=typ.Qualities)  # -> Quality, Valid, Name, Value, Unit, Definition
panel_2 = Panel(qal.Name)
txt = EncodeText(Text=concat_2)
panel_3 = Panel(txt)
panel_4 = Panel(qal.Value)

# ----
# Constructors
validate = BooleanToggle(True)

list = ValueList({"Dsn(Nakagin Capsule Tower)": 0, "Dsn(Nakagin Capsule Tower,Slanted)": 1, "Dsn(Nakagin Capsule Tower,Twisted)": 2, "Dsn(Nakagin Capsule Tower,Dancing,Explosion Axonometry)": 3}, selected="Dsn(Nakagin Capsule Tower)")
list_2 = ValueList({"Typ(Base)": 0, "Typ(Base,Blob)": 1, "Typ(Bridge)": 2, "Typ(Capital)": 3, "Typ(Cylindric Capital)": 4, "Typ(Capsule,\)": 5, "Typ(Capsule,/)": 6, "Typ(Capsule,q)": 7, "Typ(Capsule,p)": 8, "Typ(Capsule,J)": 9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}, selected=["Typ(Capsule,\)", "Typ(Capsule,/)", "Typ(Capsule,q)", "Typ(Capsule,p)", "Typ(Capsule,J)", "Typ(Capsule,L)": 10, "Typ(Capsule,s)": 11, "Typ(Capsule,z)": 12, "Typ(Tambour)": 37])

spt = ModelScreenPoint(Validate=validate)  # -> ScreenPoint, Valid, X, Y

# ----
# Point missing
# Direction missing
por = ModelPort(Validate=validate)  # -> Port, Valid, Id, Point, Direction, Locators, Locators_2

# ----
# Url missing
rep = ModelRepresentation(Validate=validate)  # -> Representation, Valid, Url, Mime, Lod, Tags

# ----
# Group missing
loc = ModelLocator(Validate=validate)  # -> Locator, Valid, Group, Subgroup

# ----
# Name missing
qal_2 = ModelQuality(Validate=validate)  # -> Quality, Valid, Name, Value, Unit, Definition

# ----
# Connected equal Connecting
con = ModelConnection(Validate=validate)  # -> Connection, Valid, ConnectedPieceId, ConnectedPieceTypePortId, ConnectingPieceId, ConnectingPieceTypePortId, Rotation, Tilt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

# ----
# Normalization not affecting semantics
item = ListItem(List=dn, Index=0, Wrap=True)
dsn = NormalizeDesign(dn=item)
shwdsn = ShowDesign(dn=item, ty=ty, mm="model/vnd.3dm")  # -> id_2, ur_2, pln_2
shwdsn_2 = ShowDesign(dn=dsn, ty=ty, mm="model/vnd.3dm")  # -> id_2, ur_2, pln_2
tsort = SortText(Keys=shwdsn_2.id_2, Values=shwdsn_2.pln_2, Culture=127)  # -> Keys, Values
tsort_2 = SortText(Keys=shwdsn.id_2, Values=shwdsn.pln_2, Culture=127)  # -> Keys, Values
expression = Expression(x=tsort_2.Values, y=tsort.Values, Expression="x=y")
mm = MassMultiplication(Input=expression)  # -> Result, PartialResults
bool = Boolean(mm.Result)
must_be_true = Panel(bool)

# ----
# Type Name missing
pce = ModelPiece(Validate=validate)  # -> Piece, Valid, Id, TypeName, TypeVariant, Plane, DiagramPoint

# ----
# Name missing
typ_2 = ModelType(Validate=validate)  # -> Type, Valid, Name, Description, Icon, Variant, Unit, Representations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

# ----
# Name missing
dsn_2 = ModelDesign(Validate=validate)  # -> Design, Valid, Name, Description, Icon, Variant, Unit, Pieces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

# ----
# Name missing
kit_4 = ModelKit(Validate=validate)  # -> Kit, Valid, Name, Description, Icon, Version, Remote, Homepage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

item_2 = ListItem(List=ty, Index=list_2, Wrap=True)
item_3 = ListItem(List=ty, Index=list_2, Wrap=True)
panel_5 = Panel("IdToooooooooooooooooooooooooooooooooooooooLooooooooooooooooooooooooooooooooooooooooooooooooooongggggggggggggggggggggggggggggggggg")
panel_6 = Panel("NameToooooooooooooooooLoooooooooooooooooooooonggggggggggggggggggg")
panel_7 = Panel("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")
dsn_3 = PredictDesign(Description="Tambour with a capsule on every door.", Types=item_2, Run=Toggle(False))  # -> Success, Design
dsn_4 = PredictDesign(Description="A stack of five tambours with a capsule on every door.", Types=item_3, Run=Toggle(False))  # -> Success, Design
panel_8 = Panel("SecondName")
dam = DataDam(DataA=dsn_4.Design, BufferDelay=10000000, BufferMode=0)
dam_2 = DataDam(DataA=dsn_3.Design, BufferDelay=10000000, BufferMode=0)
dn_2 = Design("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")
mime = Mime({".stl": "model/stl", ".obj": "model/obj", ".glb": "model/gltf-binary", ".gltf": "model/gltf+json", ".3dm": "model/vnd.3dm", ".speckle": "model/vnd.speckle+json", ".png": "image/png", ".jpg": "image/jpeg", ".jpeg": "image/jpeg", ".svg": "image/svg+xml", ".pdf": "application/pdf", ".zip": "application/zip", ".json": "application/json", ".csv": "text/csv", ".txt": "text/plain"}, selected=".3dm")

# ----
# Id too long
pt = ConstructPoint(XCoordinate=0, YCoordinate=0, ZCoordinate=0)
X = UnitX(Factor=1)
por_2 = ModelPort(Validate=validate, Id=panel_5, Point=pt, Direction=X)  # -> Port, Valid, Id, Point, Direction, Locators, Locators_2

# ----
# Url too long
rep_2 = ModelRepresentation(Validate=validate, Url="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")  # -> Representation, Valid, Url, Mime, Lod, Tags

# ----
# Lod too long
rep_3 = ModelRepresentation(Validate=validate, Url="https://url", Mime="https://url", Lod=panel_6)  # -> Representation, Valid, Url, Mime, Lod, Tags

list_3 = ValueList({"1to500", "1to200"}, selected="1to500")

# ----
# Description too long
typ_3 = ModelType(Validate=validate, Name="Name", Description=panel_7)  # -> Type, Valid, Name, Description, Icon, Variant, Unit, Representations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

shwdsn_3 = ShowDesign_2(dn=dn_2, ty=ty, mm=mime, lod=list_3, tags="volume")  # -> id_2, ur_2, pa_ur_2, pln_2

# ----
# Props
# Tag too long
rep_4 = ModelRepresentation(Validate=validate, Url="https://url", Mime="https://url", Tags=panel_6)  # -> Representation, Valid, Url, Mime, Lod, Tags

# ----
# Id too long
pce_2 = ModelPiece(Validate=validate, Id=panel_5, TypeName="Name")  # -> Piece, Valid, Id, TypeName, TypeVariant, Plane, ScreenPoint

concat_6 = Concatenate(FragmentA=concat_5, FragmentB=sep, FragmentC=shwdsn_3.pa_ur_2)

# ----
# Description too long
dsn_5 = ModelDesign(Validate=validate, Name="Name", Description=panel_7)  # -> Design, Valid, Name, Description, Icon, Variant, Unit, Pieces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

# ----
# Mime too long
rep_5 = ModelRepresentation(Validate=validate, Url="https://url", Mime=panel_5)  # -> Representation, Valid, Url, Mime, Lod, Tags

geo = LoadGeometry(path=flatten(concat_6), pln=flatten(shwdsn_3.pln_2), run=Toggle(True))  # -> object_4, col_2, shader_2
geo_2 = SemioGeometryPreview(geo=flatten(geo.object_4))

# ----
# Description too long
kit_5 = ModelKit(Validate=validate, Name="Name", Description=panel_7)  # -> Kit, Valid, Name, Description, Icon, Version, Remote, Homepage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

# ----
# Connected equal Connecting
con_2 = ModelConnection(Validate=validate, ConnectedPieceId="0", ConnectingPieceId="0")  # -> Connection, Valid, ConnectedPieceId, ConnectedPieceTypePortId, ConnectingPieceId, ConnectingPieceTypePortId, Rotation, Tilt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

# ----
# Piece not part
con_3 = ModelConnection(ConnectedPieceId="0", ConnectingPieceId="1")  # -> Connection, Valid, ConnectedPieceId, ConnectedPieceTypePortId, ConnectingPieceId, ConnectingPieceTypePortId, Rotation, Tilt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
dsn_6 = ModelDesign(Validate=validate, Name="Name", Connections=con_3.Connection)  # -> Design, Valid, Name, Description, Icon, Image, Variant, View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

panel_9 = Panel("1ef59aec9f6d93a2878d3771c6401209c9ba597c")
panel_10 = Panel("main-tag")
# UserObjects
panel_11 = Panel("usalu")
ghbkit = GitHubKit(domain="github.com", account="metabolism", repo="main", branch="main")  # -> remote_2, homepage_2
panel_12 = Panel(ghbkit.remote_2)
panel_13 = Panel(ghbkit.homepage_2)
panel_14 = Panel("https://github.com/usalu/metabolism/archive/1ef59aec9f6d93a2878d3771c6401209c9ba597c.zip")
panel_15 = Panel("https://github.com/usalu/metabolism/tree/1ef59aec9f6d93a2878d3771c6401209c9ba597c")

panel_16 = Panel("Slanted")
panel_17 = Panel("Twisted")
dn_3 = Design(dn)
seldsn = SelectDesign(dn=dn_3, na="Nakagin Capsule Tower")
seldsn_2 = SelectDesign(dn=dn_3, na="Nakagin Capsule Tower", variant="Dancing", view="Explosion Axonometry")
seldsn_3 = SelectDesign(dn=dn_3, na="Nakagin Capsule Tower")
seldsn_4 = SelectDesign(dn=dn_3, na="Nakagin Capsule Tower")

toggle = BooleanToggle(False)

# ----
# Creating Kit without losing information
kit_6 = DeleteKit(Url=concat_2, Run=toggle)
kt_3 = Kit(kt_2)
expression_2 = Expression(x=toggle, y=kit_6, Expression="x")
kit_7 = SerializeKit(Kit=kt_3)
kit_8 = CreateKit(Kit=kt_3, Uri=concat_2, Run=toggle)
expression_3 = Expression(x=toggle, y=kit_8, Expression="x")
kit_9 = LoadKit(Uri=concat_2, Run=expression_3)  # -> Success, Kit, LocalDirectory
kit_10 = SerializeKit(Kit=kit_9.Kit)
expression_4 = Expression(x=kit_7, y=kit_10, Expression="x=y")
must_be_true_2 = Panel(expression_4)

# ----
# Overwrite types and designs
expression_5 = Expression(x=toggle, y=must_be_true_2, Expression="x")
kt_4 = Kit(kt_2)
kit_11 = ModelKit(Kit=kt_4)  # -> Kit, Valid, Name, Description, Icon, Image, Preview, Version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
kit_12 = DeleteKit(Url=concat_2, Run=expression_5)
expression_6 = Expression(x=expression_5, y=kit_12, Expression="x")
kit_13 = NormalizeKit(kt=kt_4)
trim_3 = TrimTree(Tree=kit_11.Types, Depth=1)
trim_4 = TrimTree(Tree=kit_11.Designs, Depth=1)
kit_14 = CreateKit(Kit=kt_4, Uri=concat_2, Run=toggle)
typ_4 = PutType(Type=trim_3, Uri=concat_2, Run=False)
dsn_7 = PutDesign(Design=trim_4, Uri=concat_2, Run=False)
kit_15 = SerializeKit(Kit=kit_13)
expression_7 = Expression(x=expression_5, y=kit_14, Expression="x")
item_4 = ListItem(List=typ_4, Index=0, Wrap=True)
expression_8 = Expression(x=expression_5, y=item_4, Expression="x")
item_5 = ListItem(List=dsn_7, Index=0, Wrap=True)
kit_16 = LoadKit(Uri=concat_2, Run=expression_7)  # -> Success, Kit, LocalDirectory
expression_9 = Expression(x=expression_5, y=kit_16.Success, Expression="x")
expression_10 = Expression(x=expression_5, y=item_5, Expression="x")
kit_17 = LoadKit(Uri=concat_2, Run=expression_10)  # -> Success, Kit, LocalDirectory
kit_18 = NormalizeKit(kt=kit_17.Kit)
kit_19 = SerializeKit(Kit=kit_18)
expression_11 = Expression(x=kit_15, y=kit_19, Expression="x=y")
must_be_true_3 = Panel(expression_11)

and = GateAnd(A=must_be_true_2, B=must_be_true_3, C=must_be_true_2)
must_be_true_4 = Panel(and)

# ==== cluster ShowDesign: Show a design by flattening it and selecting only representations with the same mime, lod and tags.
ty = ClusterInput()
dn = ClusterInput()
mm = ClusterInput()
lod = ClusterInput()
tags = ClusterInput()
ty_2 = Type(ty)
mm_2 = Mime(mm)
tags_2 = Tags(tags)
dn_2 = Design(dn)
lod_2 = Lod(lod)
fltdsn = FlattenDesign(Design=dn_2, Type=ty_2)
typ = ModelType(Type=ty_2)  # -> Type, Valid, Name, Description, Icon, Variant, Unit, Representations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
dsn = ModelDesign(Design=fltdsn)  # -> Design, Valid, Name, Description, Icon, Variant, Unit, Pieces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
tstat = TreeStatistics(Tree=typ.Representations)  # -> Paths, Length, Count
trim = TrimTree(Tree=dsn.Pieces, Depth=1)
pce = ModelPiece(Piece=trim)  # -> Piece, Valid, Id, TypeName, TypeVariant, Plane, ScreenPoint
lng = ListLength(List=ty_2)
expression = Expression(x=graft(pce.TypeName), y=typ.Name, Expression="x=y")
expression_2 = Expression(x=graft(pce.TypeVariant), y=typ.Variant, Expression="x=y")
series = Series(Start=0, Step=1, Count=lng)
and = GateAnd(A=expression, B=expression_2)
trim_2 = TrimTree(Tree=series, Depth=1)
cull = CullPattern(List=ty_2, CullPattern=and)
txt = Text(cull)
txt_2 = Text(ty_2)
expression_3 = Expression(x=txt, y=txt_2, Expression="x=y")
cull_2 = CullPattern(List=trim_2, CullPattern=expression_3)
trim_3 = TrimTree(Tree=cull_2, Depth=1)
item = ListItem(List=tstat.Paths, Index=trim_3, Wrap=True)
branch = TreeBranch(Tree=typ.Representations, Path=item, MaintainPaths=False)
mrg_p = MergeSeperatlyPrepend(x=branch)  # -> Mrgd; inputs x: tree
# ---------- mrg_p: Python ----------
if ghenv.Component.RunCount<2:
    __author__ = "Ueli Saluz"
    __version__ = "2020.05.28"
    
    ghenv.Component.Name = "MergeSeperatly(Prepend)"
    ghenv.Component.NickName = "Mrg(P)"
    ghenv.Component.Description = "Merge inputs seperatly on a new path. Prepend index of input parameter for distincting."
    ghenv.Component.Message = "VER 1.0"

from System import Object
from Grasshopper import DataTree
from Grasshopper.Kernel import GH_ParamAccess as Access

if __name__ == "__main__":
    Mrgd = DataTree[Object]()
    access = Access()
    
    for input in ghenv.Component.Params.Input:  #set all Inputaccess to Tree Access
        input.Access = access.tree
    
    for i,input in enumerate(ghenv.Component.Params.Input):
        for j,source in enumerate(input.Sources):
            for path in source.VolatileData.Paths:
                Mrgd.AddRange(source.VolatileData[path],path.PrependElement(i))
# ---------- end mrg_p ----------
rep = ModelRepresentation(Representation=mrg_p)  # -> Representation, Valid, Url, Mime, Lod, Tags
expression_4 = Expression(x=rep.Mime, y=mm_2, Expression="x=y")
cull_3 = CullPattern(List=rep.Representation, CullPattern=expression_4)
rep_2 = ModelRepresentation(Representation=cull_3)  # -> Representation, Valid, Url, Mime, Lod, Tags
expression_5 = Expression(x=rep_2.Lod, y=lod_2, Expression="x=y")
cull_4 = CullPattern(List=rep_2.Representation, CullPattern=expression_5)
trim_4 = TrimTree(Tree=cull_4, Depth=1)
rep_3 = ModelRepresentation(Representation=trim_4)  # -> Representation, Valid, Url, Mime, Lod, Tags
ur = Url(rep_3.Url)
id = Id(pce.Id)
pln = Plane(pce.Plane)
ur_2 = ClusterOutput(ur)
pln_2 = ClusterOutput(pln)
id_2 = ClusterOutput(id)

# ==== cluster NormalizeDesign: Normalize a design for this document. This includes changing the unit to the document unit and rescaling the affected values. Further it reoders pieces, connections and qualities. Connections might be swapped, so that the connected piece id is lexically first.
dn = ClusterInput()
dn_2 = Design(graft(dn))
dsn = ModelDesign()  # -> Design, Valid, Name, Description, Icon, Variant, Unit, Pieces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
dsn_2 = ModelDesign(Design=dn_2)  # -> Design, Valid, Name, Description, Icon, Variant, Unit, Pieces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
trim = TrimTree(Tree=dsn_2.Pieces, Depth=1)
trim_2 = TrimTree(Tree=dsn_2.Qualities, Depth=1)
trim_3 = TrimTree(Tree=dsn_2.Connections, Depth=1)
cnvunt = ConvertUnit(Value=1, FromUnit=dsn_2.Unit, ToUnit=dsn.Unit)
con = ModelConnection(Connection=trim_3)  # -> Connection, Valid, ConnectedPieceId, ConnectedPieceTypePortId, ConnectingPieceId, ConnectingPieceTypePortId, Rotation, Tilt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
multiplication = Multiplication(A=con.Gap, B=cnvunt)
multiplication_2 = Multiplication(A=con.Shift, B=cnvunt)
con_2 = ModelConnection(Connection=con.Connection, Gap=multiplication, Shift=multiplication_2)  # -> Connection, Valid, ConnectedPieceId, ConnectedPieceTypePortId, ConnectingPieceId, ConnectingPieceTypePortId, Rotation, Tilt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
merge = Merge(Data1=graft(con_2.ConnectedPieceId), Data2=graft(con_2.ConnectingPieceId))
tsort = SortText(Keys=merge, Culture=127)  # -> Keys, Values
trim_4 = TrimTree(Tree=tsort.Keys, Depth=1)
expression = Expression(x=merge, y=trim_4, Expression="x=y")
item = ListItem(List=expression, Index=0, Wrap=True)
trim_5 = TrimTree(Tree=item, Depth=1)
dispatch = Dispatch(List=con_2.Connection, DispatchPattern=trim_5)  # -> ListA, ListB
con_3 = ModelConnection(Connection=dispatch.ListB)  # -> Connection, Valid, ConnectedPieceId, ConnectedPieceTypePortId, ConnectingPieceId, ConnectingPieceTypePortId, Rotation, Tilt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
con_4 = ModelConnection(
    Connection=dispatch.ListB,
    ConnectedPieceId=con_3.ConnectingPieceId,
    ConnectedPieceTypePortId=con_3.ConnectingPieceTypePortId,
    ConnectingPieceId=con_3.ConnectedPieceId,
    ConnectingPieceTypePortId=con_3.ConnectedPieceTypePortId)  # -> Connection, Valid, ConnectedPieceId, ConnectedPieceTypePortId, ConnectingPieceId, ConnectingPieceTypePortId, Rotation, Tilt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
merge_2 = Merge(Data1=dispatch.ListA, Data2=con_4.Connection)
con_5 = ModelConnection(Connection=merge_2)  # -> Connection, Valid, ConnectedPieceId, ConnectedPieceTypePortId, ConnectingPieceId, ConnectingPieceTypePortId, Rotation, Tilt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
concat = Concatenate(FragmentA=con_5.ConnectedPieceId, FragmentC="##", FragmentB=con_5.ConnectingPieceId)
qal = ModelQuality(Quality=trim_2)  # -> Quality, Valid, Name, Value, Unit, Definition
pce = ModelPiece(Piece=trim)  # -> Piece, Valid, Id, TypeName, TypeVariant, Plane, ScreenPoint
tsort_2 = SortText(Keys=concat, Values=con_5.Connection, Culture=127)  # -> Keys, Values
tsort_3 = SortText(Keys=qal.Name, Values=qal.Quality, Culture=127)  # -> Keys, Values
tsort_4 = SortText(Keys=pce.Id, Values=pce.Piece, Culture=127)  # -> Keys, Values
trim_6 = TrimTree(Tree=tsort_2.Values, Depth=1)
trim_7 = TrimTree(Tree=tsort_3.Values, Depth=1)
trim_8 = TrimTree(Tree=tsort_4.Values, Depth=1)
dsn_3 = ModelDesign(Design=dsn_2.Design, Unit=dsn.Unit, Pieces=trim_8, Connections=trim_6, Qualities=trim_7)  # -> Design, Valid, Name, Description, Icon, Variant, Unit, Pieces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
trim_9 = TrimTree(Tree=dsn_3.Design, Depth=1)
dn_3 = Design(trim_9)
dn_4 = ClusterOutput(dn_3)

# ==== cluster GitHubKit: Get the uri and the homepage of the remote kit of a specific version (either a branch name, a tag name or a commit sha) for a kit hosted as a repository on GitHub.
domain = ClusterInput()
account = ClusterInput()
repo = ClusterInput()
branch = ClusterInput()
tag = ClusterInput()
commit = ClusterInput()
commit_2 = Text(commit)
domain_2 = Text(domain)
account_2 = Text(account)
repo_2 = Text(repo)
branch_2 = Text(branch)
tag_2 = Text(tag)
null = NullItem(Item=domain_2)  # -> NullFlags, InvalidFlags, Description

null_2 = NullItem(Item=tag_2)  # -> NullFlags, InvalidFlags, Description
null_3 = NullItem(Item=commit_2)  # -> NullFlags, InvalidFlags, Description
null_4 = NullItem(Item=branch_2)  # -> NullFlags, InvalidFlags, Description
not = GateNot(A=null_2.NullFlags)
not_2 = GateNot(A=null_3.NullFlags)
not_3 = GateNot(A=null_4.NullFlags)
merge = Merge(Data1=not_3, Data2=not, Data3=not_2)
int = Integer(merge)
ma = MassAddition(Input=int)  # -> Result, PartialResults
expression = Expression(x=ma.Result, Expression="x≠1")
null_5 = NullItem(Item=account_2)  # -> NullFlags, InvalidFlags, Description
null_6 = NullItem(Item=repo_2)  # -> NullFlags, InvalidFlags, Description
or = GateOr(A=expression, D=null.NullFlags, B=null_5.NullFlags, C=null_6.NullFlags)

filter = StreamFilter(Gate=null_4.NullFlags, Stream0="heads", Stream1="tags")
filter_2 = StreamFilter(Gate=null_4.NullFlags, Stream0=branch_2, Stream1=tag_2)
concat = Concatenate(FragmentA="https://", FragmentE=domain_2, FragmentF="/", FragmentB=account_2, FragmentC="/", FragmentD=repo_2)
concat_2 = Concatenate(FragmentA="refs/", FragmentB=filter, FragmentC="/")
filter_3 = StreamFilter(Gate=null_3.NullFlags, Stream1=concat_2)
filter_4 = StreamFilter(Gate=null_3.NullFlags, Stream0=commit_2, Stream1=filter_2)
concat_3 = Concatenate(FragmentA=concat, FragmentE="/archive/", FragmentC=filter_3, FragmentF=filter_4, FragmentG=".zip")
concat_4 = Concatenate(
    FragmentA=concat,
    FragmentB="/",
    FragmentC="tree",
    FragmentF="/",
    FragmentD=branch_2,
    FragmentE=tag_2,
    FragmentG=commit_2)

filter_5 = StreamFilter(Gate=or, Stream0=concat_3)
filter_6 = StreamFilter(Gate=or, Stream0=concat_4)
remote = Remote(filter_5)
homepage = Homepage(filter_6)
remote_2 = ClusterOutput(remote)
homepage_2 = ClusterOutput(homepage)

# ==== cluster SelectDesign: Select a design with a name, an optional variant and an optional view. If no variant is provided it will select all variants. If you want to select the default variant then use the empty text. If no view is provided it will select all views. If you want to select the default view then use the empty text.
dn = ClusterInput()
na = ClusterInput()
variant = ClusterInput()
view = ClusterInput()
dn_2 = Design(dn)
na_2 = Name(na)
variant_2 = Variant(variant)
view_2 = View(view)
dsn = ModelDesign(Design=dn_2)  # -> Design, Valid, Name, Description, Icon, Image, Variant, View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
expression = Expression(x=dsn.Name, y=na_2, Expression="x=y")
cull = CullPattern(List=dsn.Design, CullPattern=expression)
dsn_2 = ModelDesign(Design=cull)  # -> Design, Valid, Name, Description, Icon, Image, Variant, View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
expression_2 = Expression(x=dsn_2.Variant, y=variant_2, Expression="x=y")
null = NullItem(Item=view_2)  # -> NullFlags, InvalidFlags, Description
cull_2 = CullPattern(List=dsn_2.Design, CullPattern=expression_2)
dsn_3 = ModelDesign(Design=cull_2)  # -> Design, Valid, Name, Description, Icon, Image, Variant, View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
expression_3 = Expression(x=dsn_3.View, y=view_2, Expression="x=y")
cull_3 = CullPattern(List=dsn_3.Design, CullPattern=expression_3)
filter = StreamFilter(Gate=null.NullFlags, Stream0=cull_3, Stream1=cull_2)
null_2 = NullItem(Item=variant_2)  # -> NullFlags, InvalidFlags, Description
filter_2 = StreamFilter(Gate=null_2.NullFlags, Stream0=filter, Stream1=cull)
dn_3 = Design(filter_2)
dn_4 = ClusterOutput(dn_3)

# ==== cluster SemioGeometryPreview: semio styled preview of geometry.
geo = ClusterInput()
geo_2 = Geometry(flatten(geo))
debrep = DeconstructBrep(Brep=geo_2)  # -> Faces, Edges, Vertices
preview = CustomPreview(Geometry=flatten(debrep.Edges), Material=ColourSwatch(SwatchColor=RGB(0, 0, 0)))
preview_2 = CustomPreview(Geometry=flatten(debrep.Faces), Material=ColourSwatch(SwatchColor=RGB(255, 255, 255)))

# ==== cluster ShowDesign_2: Show a design by flattening it and selecting only representations with the same mime, lod and tags.
ty = ClusterInput()
dn = ClusterInput()
mm = ClusterInput()
lod = ClusterInput()
tags = ClusterInput()
ty_2 = Type(ty)
mm_2 = Mime(mm)
tags_2 = Tags(tags)
dn_2 = Design(dn)
lod_2 = Lod(lod)
fltdsn = FlattenDesign(Design=dn_2, Type=ty_2)
dsn = ModelDesign(Design=fltdsn)  # -> Design, Valid, Name, Description, Icon, Image, Variant, View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
typ = ModelType(Type=ty_2)  # -> Type, Valid, Name, Description, Icon, Image, Variant, Unit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
trim = TrimTree(Tree=dsn.Pieces, Depth=1)
tstat = TreeStatistics(Tree=typ.Representations)  # -> Paths, Length, Count
pce = ModelPiece(Piece=trim)  # -> Piece, Valid, Id, TypeName, TypeVariant, Plane, ScreenPoint
expression = Expression(x=graft(pce.TypeName), y=typ.Name, Expression="x=y")
expression_2 = Expression(x=graft(pce.TypeVariant), y=typ.Variant, Expression="x=y")
and = GateAnd(A=expression, B=expression_2)
cull = CullPattern(List=ty_2, CullPattern=and)
lng = ListLength(List=ty_2)
txt = Text(cull)
series = Series(Start=0, Step=1, Count=lng)
txt_2 = Text(ty_2)
expression_3 = Expression(x=txt, y=txt_2, Expression="x=y")
trim_2 = TrimTree(Tree=series, Depth=1)
cull_2 = CullPattern(List=trim_2, CullPattern=expression_3)
trim_3 = TrimTree(Tree=cull_2, Depth=1)
item = ListItem(List=tstat.Paths, Index=trim_3, Wrap=True)
branch = TreeBranch(Tree=typ.Representations, Path=item, MaintainPaths=False)
mrg_p = MergeSeperatlyPrepend(x=branch)  # -> Mrgd; inputs x: tree; same code as mrg_p
selrep = SelectRepresentation(rp=mrg_p, mm=mm_2, lod=lod_2, tags=tags_2)  # -> rp_4, ur_2, pa_ur_2
trim_4 = TrimTree(Tree=selrep.ur_2, Depth=1)
trim_5 = TrimTree(Tree=selrep.pa_ur_2, Depth=1)
id = Id(pce.Id)
ur = Url(trim_4)
pa_ur = Url(trim_5)
pln = Plane(pce.Plane)
id_2 = ClusterOutput(id)
ur_2 = ClusterOutput(ur)
pa_ur_2 = ClusterOutput(pa_ur)
pln_2 = ClusterOutput(pln)

# ==== cluster LoadGeometry: Load local geometry from absolute file paths to planes.
path = ClusterInput()
pln = ClusterInput()
run = ClusterInput()
pln_2 = Plane(graft(pln))
path_2 = FilePath(path)
run_2 = Boolean(run)
import = ImportContent(
    FilePath=path_2,
    Name="*",
    Layer="*",
    Linetype="*",
    HatchPattern="*",
    AnnotationStyles="*",
    Materials="*",
    BlockDefinitions="*",
    Import=run_2)  # -> ModelTransform, Objects, Layers, Linetypes, HatchPatterns, AnnotationStyles, Materials, BlockDefinitions
object = ModelObject(Object=import.Objects)  # -> Object, Geometry, Name, Layer, Visibility, Display, Drafting, Render
orient = Orient(Geometry=object.Geometry, Source=PlaneXY(0, 0, 0), Target=pln_2)  # -> Geometry, Transform
object_2 = ModelObject(Object=object.Object, Geometry=orient.Geometry)  # -> Object, Geometry, Name, Layer, Visibility, Display, Drafting, Render
layer = ModelLayer(Layer=object_2.Layer)  # -> Layer, Name, Hidden, Locked, DisplayColour, Material, Linetype
display = DisplayAttributes(Display=object_2.Display)  # -> Display, DisplayColour, DisplayMode
display_colour = DisplayColour(DisplayColour=layer.DisplayColour)  # -> DisplayColour, Source, Colour
material = ModelMaterial(Material=layer.Material)  # -> Material, Name, Shader
display_colour_2 = DisplayColour(DisplayColour=display.DisplayColour)  # -> DisplayColour, Source, Colour
object_3 = ModelObject(object_2.Object)
col = Colour(display_colour.DisplayColour)
shader = Shader(material.Shader)
preview = CustomPreview(Geometry=object_3, Material=material.Shader)
object_4 = ClusterOutput(object_3)
shader_2 = ClusterOutput(shader)
col_2 = ClusterOutput(col)

# ==== cluster NormalizeKit: Normalize a kit to this document. This normalizes all types and designs and reorders them. Types are reordered after name and variant and designs after name, variant and view.
kt = ClusterInput()
kt_2 = Kit(graft(kt))
kit = ModelKit(Kit=kt_2)  # -> Kit, Valid, Name, Description, Icon, Image, Preview, Version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
trim = TrimTree(Tree=kit.Designs, Depth=1)
trim_2 = TrimTree(Tree=kit.Types, Depth=1)
dsn = NormalizeDesign_2(dn=trim)
typ = NormalizeType(ty=trim_2)
typ_2 = ModelType(Type=typ)  # -> Type, Valid, Name, Description, Icon, Image, Variant, Unit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
dsn_2 = ModelDesign(Design=dsn)  # -> Design, Valid, Name, Description, Icon, Image, Variant, View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
concat = Concatenate(FragmentA=dsn_2.Name, FragmentB="##", FragmentC=dsn_2.Variant, FragmentD="##", FragmentE=dsn_2.View)
concat_2 = Concatenate(FragmentA=typ_2.Name, FragmentB="##", FragmentC=typ_2.Variant)
tsort = SortText(Keys=concat, Values=dsn_2.Design, Culture=127)  # -> Keys, Values
tsort_2 = SortText(Keys=concat_2, Values=typ_2.Type, Culture=127)  # -> Keys, Values
trim_3 = TrimTree(Tree=tsort.Values, Depth=1)
trim_4 = TrimTree(Tree=tsort_2.Values, Depth=1)
kit_2 = ModelKit(Kit=kit.Kit, Types=trim_4, Designs=trim_3)  # -> Kit, Valid, Name, Description, Icon, Image, Preview, Version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
trim_5 = TrimTree(Tree=kit_2.Kit, Depth=1)
kt_3 = Kit(trim_5)
kt_4 = ClusterOutput(kt_3)

# ==== cluster SelectRepresentation: Select a representation based on mime, lod and tags. The mime and lod must be equal and the tags must contain all the given tags.
rp = ClusterInput()
mm = ClusterInput()
lod = ClusterInput()
tags = ClusterInput()
rp_2 = Representation(rp)
mm_2 = Mime(mm)
lod_2 = Lod(lod)
tags_2 = Tags(tags)
rep = ModelRepresentation(Representation=rp_2)  # -> Representation, Valid, Url, Mime, Lod, Tags
expression = Expression(x=rep.Mime, y=mm_2, Expression="x=y")
cull = CullPattern(List=rep.Representation, CullPattern=expression)
rep_2 = ModelRepresentation(Representation=cull)  # -> Representation, Valid, Url, Mime, Lod, Tags
expression_2 = Expression(x=rep_2.Lod, y=lod_2, Expression="x=y")
cull_2 = CullPattern(List=rep_2.Representation, CullPattern=expression_2)
rep_3 = ModelRepresentation(Representation=cull_2)  # -> Representation, Valid, Url, Mime, Lod, Tags
trim = TrimTree(Tree=rep_3.Tags, Depth=1)
contains = Contains(L=trim, I=tags_2)  # -> R; inputs L: list, I: list
# ---------- contains: Python ----------
#Component Information
#--------------------------------------------------------------------------------------------
if ghenv.Component.RunCount<2:
    #General
    #--------------------------------------------------------------------------------------------
    __author__ = "Ueli Saluz"
    __version__ = "2023.02.04"
    
    ghenv.Component.Name = "Contains"
    ghenv.Component.NickName = "Contains"
    ghenv.Component.Description = "True if list contains one of the items."
    ghenv.Component.Message = "VER 1.0"
    ghenv.Component.Category = "Set"
    ghenv.Component.SubCategory = "List"
    
     #Inputs
    #--------------------------------------------------------------------------------------------
    inputIndex=0
    
    ghenv.Component.Params.Input[inputIndex].Name = "List"
    ghenv.Component.Params.Input[inputIndex].NickName = "L"
    ghenv.Component.Params.Input[inputIndex].Description = ""
    ghenv.Component.Params.Input[inputIndex].Optional = False
    inputIndex+=1
    
    ghenv.Component.Params.Input[inputIndex].Name = "Items"
    ghenv.Component.Params.Input[inputIndex].NickName = "I"
    ghenv.Component.Params.Input[inputIndex].Description = ""
    ghenv.Component.Params.Input[inputIndex].Optional = False
    inputIndex+=1
    
    #Outputs
    #--------------------------------------------------------------------------------------------
    outputIndex=0
    
    ghenv.Component.Params.Output[outputIndex].Name = "Contains"
    ghenv.Component.Params.Output[outputIndex].NickName = "R"
    ghenv.Component.Params.Output[outputIndex].Description = ""
    outputIndex+=1

R = False
for i in I:
    if i in L:
        R = True
# ---------- end contains ----------
ma = MassAddition(Input=contains)  # -> Result, PartialResults
lng = ListLength(List=contains)
equals = Equality(FirstNumber=ma.Result, SecondNumber=lng)  # -> Equality, Inequality
cull_3 = CullPattern(List=rep_3.Representation, CullPattern=equals.Equality)
rep_4 = ModelRepresentation(Representation=cull_3)  # -> Representation, Valid, Url, Mime, Lod, Tags
curdir = CSharpScript()  # -> D, S
# ---------- curdir: C# ----------
#region Usings
using System;
using System.Linq;
using System.Collections;
using System.Collections.Generic;
using System.Drawing;
using System.IO;

using Rhino;
using Rhino.Geometry;

using Grasshopper;
using Grasshopper.Kernel;
using Grasshopper.Kernel.Data;
using Grasshopper.Kernel.Types;
#endregion

public class Script_Instance : GH_ScriptInstance
{
    private void RunScript(ref object D, ref object S)
    {
        D = Path.GetDirectoryName(this.GrasshopperDocument.FilePath);
        S = Path.DirectorySeparatorChar;
    }
}
# ---------- end curdir ----------
rep_5 = ReplaceText(Text=rep_4.Url, Find="/", Replace=curdir.S, RecursiveReplace=False)
rp_3 = Representation(rep_4.Representation)
pa_ur = Text(rep_5)
ur = Url(rep_4.Url)
rp_4 = ClusterOutput(rp_3)
ur_2 = ClusterOutput(ur)
pa_ur_2 = ClusterOutput(pa_ur)

# ==== cluster NormalizeType: Normalize a type for this document. This converts the length unit of the type to the length unit of this document and it scales the ports by the right scaling factor. Further it sorts the representations, ports, qualities by it's keys. The order of authors is not changed.
ty = ClusterInput()
ty_2 = Type(graft(ty))
typ = ModelType()  # -> Type, Valid, Name, Description, Icon, Image, Variant, Unit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
typ_2 = ModelType(Type=ty_2)  # -> Type, Valid, Name, Description, Icon, Image, Variant, Unit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
cnvunt = ConvertUnit(Value=1, FromUnit=typ_2.Unit, ToUnit=typ.Unit)
trim = TrimTree(Tree=typ_2.Ports, Depth=1)
trim_2 = TrimTree(Tree=typ_2.Representations, Depth=1)
trim_3 = TrimTree(Tree=typ_2.Qualities, Depth=1)
rep = ModelRepresentation(Representation=trim_2)  # -> Representation, Valid, Url, Mime, Lod, Tags
por = ModelPort(Port=trim)  # -> Port, Valid, Id, Point, Direction, Locators, Locators_2
qal = ModelQuality(Quality=trim_3)  # -> Quality, Valid, Name, Value, Unit, Definition
scale = Scale(Geometry=por.Point, Center=Point(0, 0, 0), Factor=cnvunt)  # -> Geometry, Transform
concat = Concatenate(FragmentA=rep.Mime, FragmentC="##", FragmentB=rep.Lod)
scale_2 = Scale(Geometry=por.Direction, Center=Point(0, 0, 0), Factor=cnvunt)  # -> Geometry, Transform
join = TextJoin(Text=rep.Tags, Join="##")
tsort = SortText(Keys=qal.Name, Values=qal.Quality, Culture=127)  # -> Keys, Values
por_2 = ModelPort(Port=por.Port, Point=scale.Geometry, Direction=scale_2.Geometry)  # -> Port, Valid, Id, Point, Direction, Locators, Locators_2
concat_2 = Concatenate(FragmentA=graft(concat), FragmentB=join)
trim_4 = TrimTree(Tree=tsort.Values, Depth=1)
trim_5 = TrimTree(Tree=concat_2, Depth=1)
tsort_2 = SortText(Keys=por_2.Id, Values=por_2.Port, Culture=127)  # -> Keys, Values
trim_6 = TrimTree(Tree=tsort_2.Values, Depth=1)
tsort_3 = SortText(Keys=trim_5, Values=rep.Representation, Culture=127)  # -> Keys, Values
trim_7 = TrimTree(Tree=tsort_3.Values, Depth=1)
typ_3 = ModelType(Type=typ_2.Type, Unit=typ.Unit, Representations=trim_7, Ports=trim_6, Qualities=trim_4)  # -> Type, Valid, Name, Description, Icon, Image, Variant, Unit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
trim_8 = TrimTree(Tree=typ_3.Type, Depth=1)
ty_3 = Type(trim_8)
ty_4 = ClusterOutput(ty_3)

# ==== cluster NormalizeDesign_2: Normalize a design for this document. This includes changing the unit to the document unit and rescaling the affected values. Further it reoders pieces, connections and qualities. Connections might be swapped, so that the connected piece id is lexically first. The order of authors is not changed.
dn = ClusterInput()
dn_2 = Design(graft(dn))
dsn = ModelDesign()  # -> Design, Valid, Name, Description, Icon, Image, Variant, View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
dsn_2 = ModelDesign(Design=dn_2)  # -> Design, Valid, Name, Description, Icon, Image, Variant, View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
trim = TrimTree(Tree=dsn_2.Pieces, Depth=1)
trim_2 = TrimTree(Tree=dsn_2.Qualities, Depth=1)
trim_3 = TrimTree(Tree=dsn_2.Connections, Depth=1)
cnvunt = ConvertUnit(Value=1, FromUnit=dsn_2.Unit, ToUnit=dsn.Unit)
con = ModelConnection(Connection=trim_3)  # -> Connection, Valid, ConnectedPieceId, ConnectedPieceTypePortId, ConnectingPieceId, ConnectingPieceTypePortId, Rotation, Tilt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
multiplication = Multiplication(A=con.Gap, B=cnvunt)
multiplication_2 = Multiplication(A=con.Shift, B=cnvunt)
con_2 = ModelConnection(Connection=con.Connection, Gap=multiplication, Shift=multiplication_2)  # -> Connection, Valid, ConnectedPieceId, ConnectedPieceTypePortId, ConnectingPieceId, ConnectingPieceTypePortId, Rotation, Tilt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
merge = Merge(Data1=graft(con_2.ConnectedPieceId), Data2=graft(con_2.ConnectingPieceId))
tsort = SortText(Keys=merge, Culture=127)  # -> Keys, Values
trim_4 = TrimTree(Tree=tsort.Keys, Depth=1)
expression = Expression(x=merge, y=trim_4, Expression="x=y")
item = ListItem(List=expression, Index=0, Wrap=True)
trim_5 = TrimTree(Tree=item, Depth=1)
dispatch = Dispatch(List=con_2.Connection, DispatchPattern=trim_5)  # -> ListA, ListB
con_3 = ModelConnection(Connection=dispatch.ListB)  # -> Connection, Valid, ConnectedPieceId, ConnectedPieceTypePortId, ConnectingPieceId, ConnectingPieceTypePortId, Rotation, Tilt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
con_4 = ModelConnection(
    Connection=dispatch.ListB,
    ConnectedPieceId=con_3.ConnectingPieceId,
    ConnectedPieceTypePortId=con_3.ConnectingPieceTypePortId,
    ConnectingPieceId=con_3.ConnectedPieceId,
    ConnectingPieceTypePortId=con_3.ConnectedPieceTypePortId)  # -> Connection, Valid, ConnectedPieceId, ConnectedPieceTypePortId, ConnectingPieceId, ConnectingPieceTypePortId, Rotation, Tilt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
merge_2 = Merge(Data1=dispatch.ListA, Data2=con_4.Connection)
con_5 = ModelConnection(Connection=merge_2)  # -> Connection, Valid, ConnectedPieceId, ConnectedPieceTypePortId, ConnectingPieceId, ConnectingPieceTypePortId, Rotation, Tilt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
concat = Concatenate(FragmentA=con_5.ConnectedPieceId, FragmentC="##", FragmentB=con_5.ConnectingPieceId)
pce = ModelPiece(Piece=trim)  # -> Piece, Valid, Id, TypeName, TypeVariant, Plane, ScreenPoint
qal = ModelQuality(Quality=trim_2)  # -> Quality, Valid, Name, Value, Unit, Definition
tsort_2 = SortText(Keys=concat, Values=con_5.Connection, Culture=127)  # -> Keys, Values
tsort_3 = SortText(Keys=qal.Name, Values=qal.Quality, Culture=127)  # -> Keys, Values
tsort_4 = SortText(Keys=pce.Id, Values=pce.Piece, Culture=127)  # -> Keys, Values
trim_6 = TrimTree(Tree=tsort_2.Values, Depth=1)
trim_7 = TrimTree(Tree=tsort_3.Values, Depth=1)
trim_8 = TrimTree(Tree=tsort_4.Values, Depth=1)
dsn_3 = ModelDesign(Design=dsn_2.Design, Unit=dsn.Unit, Pieces=trim_8, Connections=trim_6, Qualities=trim_7)  # -> Design, Valid, Name, Description, Icon, Image, Variant, View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
trim_9 = TrimTree(Tree=dsn_3.Design, Depth=1)
dn_3 = Design(trim_9)
dn_4 = ClusterOutput(dn_3)
